# Requirement set Requirements (R2022a)

## 1 [1] Barrier alert
Activate/Deactivate the alert on the 160 mark.

## 2 [1] Alart performance (Informational)
Make sure it works on time.

## 3 [2] Calculate speed
Calculate the current speed based on our encoder input every 3 seconds.

## 4 [2] Chage speed
After calculating the speed, if needed, accelerate or decelerate.

## 5 [2] Breaking system
Change the braking power and speed based on the alarm we got from the distance alert.

## 6 [2] State 2 performance (Informational)
The outputs should be real-time, and the braking system should be safe and reliable for passengers.

## 7 [3] Deciding moving direction
If the car is moving, it should decide based in IR input which direction to move.

## 8 [3] Deciding moving direction performance (Informational)
The decision-making process should not take long and should be safe and reliable.

## 9 [4] Seat belt alarm
Activate/Deactivate alarm based on whether the car in moving or not and if the seat belt is already fasten or not.

## 10 [4] Door alarm
Activate/Deactivate the alarm based on the door's position.

## 11 [4] Alarm performance (Informational)
Make sure not to have the error that if every condition is met and the alarm goes off.

## 12 [5] Battery reduction function
Make a function to reduce battery over time.

## 13 [5] Battery reduction performace (Informational)
The threshhold is as same as the day one.

## 14 [6] Battery alarm
Activate/Deactivate battery alarm on 20%.

## 15 [7] Car lights
Activate/Deactivate the cars lights based on the ambiant light.

## 16 [7] Car lights brightness level (Informational)
The brightness level can be changed based on outside light.